# Grasshopper definition Fluid Flow Basic Simulation and Analysis.gh (Grasshopper 1.0.7)
# plug-ins: Kangaroo2 Components

# ---- group: Inputs
number_slider = Slider(0.001, range=0..0.001)
# Description: This Grasshopper file does a basic fluid sumilation on a given geometry base on gravitational direction (Defult: 0,0,-1)
number_slider_2 = Slider(1000, range=0..1000)
number_slider_3 = Slider(10, range=0..10)
reset_button = Button()
toggle = BooleanToggle(False)
brep = Brep(<brep referenced from the Rhino model>)

# ----
popgeo = PopulateGeometry(Geometry=brep, Count=number_slider_2, Seed=1)
Z = UnitZ(Factor=Slider(0.01, range=0..0.01))
move = Move(Geometry=popgeo, Motion=Z)  # -> Geometry, Transform

# ---- group: Probes
pt = Point(move.Geometry)

# ---- group: Simulation Setup
smooth = SettingsQuality()
mesh = MeshBrep(Brep=brep, Settings=smooth)
Z_2 = UnitZ(Factor=number_slider)  # -> expr("-x", UnitVector)
onmesh = OnMesh(Points=pt, Mesh=mesh, Strength=number_slider_3)
show = Show(G=pt)
load = Load(Point=pt, ForceVector=Z_2, Weighting=1)
merge = Merge(Data1=onmesh, Data2=load, Data3=show)
solver = Solver(GoalObjects=merge, Reset=reset_button, Threshold=1e-15, Tolerance=0.0001, On=toggle)  # -> I, V, O

# ---- group: Record
c_script = CSharpScript(reset=reset_button, v=solver.V)  # -> out, vOut; inputs reset: Boolean, v: list of Point3d
# ---------- c_script: C# ----------
    if (reset){
      values = new List<Point3d>();
    }
    else{
      for( int i = 0; i < v.Count; i++){
        values.Add(v[i]);
      }}
    vOut = values;
# ---------- c_script: C# additional code ----------
  List<Point3d> values = new List<Point3d>();
# ---------- end c_script ----------

# ----
lng = ListLength(List=pt)
partition = PartitionList(List=c_script.vOut, Size=expr("x", lng))
flip = FlipMatrix(Data=partition)
cullpt = CullDuplicates(Points=flip, Tolerance=0.1, CullMode=3)  # -> Points, Indices, Valence
pline = PolyLine(Vertices=cullpt.Points, Closed=False)
clean = CleanTree(RemoveNulls=True, RemoveInvalid=True, RemoveEmpty=False, Tree=pline)
crvout = Curve(clean)
